# Dynamo graph 3DRoomTag.dyn (Dynamo 2.3.0.5885)

family_types = FamilyTypes("3dRoomTag:Name, Number")
boolean = BoolSelector(true)
n3droomtag = Custom[3droomtag](ThreeDRoomTag=family_types, RunMe=boolean)  # edit Rhythm.3DRoomTag.dyf
