# Dynamo custom node 3droomtag.dyf (Dynamo 2.3.0.5885)
# category: 3droomtag
# edit Rhythm.3DRoomTag.dyf

ThreeDRoomTag = Input(ThreeDRoomTag: Revit.Elements.FamilyType)
RunMe = Input(RunMe: bool = false)
python_script = Python(IN[0]=RunMe)
# ---------- python_script.python (41 lines) ----------
#Copyright(c) 2017, john pierson
# @60secondrevit, http://sixtysecondrevit.com

import clr
clr.AddReference('ProtoGeometry')
from Autodesk.DesignScript.Geometry import *

# Import DocumentManager and TransactionManager
clr.AddReference("RevitServices")
import RevitServices
from RevitServices.Persistence import DocumentManager
from RevitServices.Transactions import TransactionManager

# Import RevitAPI
clr.AddReference("RevitAPI")
import Autodesk
from Autodesk.Revit.DB import *
clr.AddReference("RevitNodes")


doc = DocumentManager.Instance.CurrentDBDocument
uiapp = DocumentManager.Instance.CurrentUIApplication
app = uiapp.Application

from System.Collections.Generic import *


#The inputs to this node will be stored as a list in the IN variable.
dataEnteringNode = IN
phase = UnwrapElement(IN[0])
collector = FilteredElementCollector(doc)
rooms = collector.OfCategory(BuiltInCategory.OST_Rooms).ToElements()

roomInstances = []
if IN[0] == True:
	for i in rooms:
			if i.Area != 0:
				roomInstances.append(i)
else:
	roomInstances.append("set run me to true")
OUT = roomInstances
# ----------------------------------------

# group: Room locations and parameters.
location = Room.Location(room=python_script)
number = Room.Number(room=python_script)

code_block = CodeBlock { "Name"; "이름"; }
getParameterValueByName = Element.GetParameterValueByName(element=python_script, parameterName=code_block.out1)

# group: Creates tag and sets parameters.
byPoint = FamilyInstance.ByPoint(familyType=ThreeDRoomTag, point=location)
code_block_2 = CodeBlock { "Name"; "Number"; }
setParameterByName = Element.SetParameterByName(element=byPoint, parameterName=code_block_2.out1, value=number)
setParameterByName_2 = Element.SetParameterByName(element=setParameterByName, parameterName=code_block_2.out0, value=getParameterValueByName)

ThreeDRoomTags = Output(setParameterByName_2)
