# Dynamo graph ExportIFCMultiFile.dyn (Dynamo 2.0.4.12684)

# group: Export IFC Multi File Revit
# note: CREATED BY: Chuong.Ho
# CREATED: 10/08/2020
# VERSION: 1.0.0
# LAST EDITED: 03/02/2020
# DYNAMO VERSION: 2.0 OVER
# PACKAGES:
# GeniusLoci v.2019.10.6
# Rhythm v.2019.9.12
# Contact : chuong.ho@the-bim-factory.com
# Mobile : +84345028234
# My blog : https://chuongmep.com/

# group: INPUT
# note: - Document Empty
# note: USE:
# INPUTS THAT ARE REQUIRED TO BE
# SET BY THE USER

# group: DESIGN
# note: DESIGN  :Chuong.Ho
# note: USE:
# FOR BLOCKS OF CODE THAT DO A SPECIFIC TASK

# group: BACK-END
# note: BACK-END FUNCTIONALITY

# group: USER INTERFACE
# note: 1. View

# group: INSTRUCTIONS
# note: INSTRUCTIONS:
# 1. Open Dynamo or Dynamo Player
# 2. Install Package
# 3. Run

# group: TO REVIT
# note: TO REVIT
# note: USE:
# FOR ANY GROUP THAT
# WRITES DATA TO REVIT

# group: COMMENTS
# note: COMMENTS
# note: USE:
# FOR ANY COMMENTS OR PROJECT

# group: SCRIPTS
# note: ""

# group: WIP
# note: WIP
# note: USE:
# FOR UNFINISHED OR UNTESTED
# BLOCKS OF CODE

# group: Select Path
directory_path = Directory("W:\58-한신CMR_아산탕정\05_보고서\05_시공BIM결과보고서\01_work\원본\IFC test")  # graph input

# group: DLL
directory_from_path = DirectoryObject(path=directory_path)
code_block = CodeBlock { "*.rvt"; }
getDirectoryContents = FileSystem.GetDirectoryContents(directory=directory_from_path, searchString=code_block)
boolean = BoolSelector(true)
boolean_2 = BoolSelector(true)

# group: BLL
ʳʰʸᵗʰᵐ_applications = Rhythm.Revit.Application.Applications.OpenDocumentFile(filePath=getDirectoryContents.files, detachFromCentral=boolean, preserveWorksets=boolean_2)
string = StringInput("\")
code_block_2 = CodeBlock(DirectoryPath=directory_from_path, s=string) { DirectoryPath+s; }
python_script = Python(IN[0]=ʳʰʸᵗʰᵐ_applications)
# ---------- python_script.python (12 lines) ----------
# Enable Python support and load DesignScript library
import clr
clr.AddReference('ProtoGeometry')
from Autodesk.DesignScript.Geometry import *
clr.AddReference("RevitAPI")
from Autodesk.Revit.DB import *
lst = []
docs = IN[0]
for doc in docs:
	lst.append(doc.Title.ToString())

OUT = lst
# ----------------------------------------
code_block_3 = CodeBlock { "_detached"; }
code_block_4 = CodeBlock { ""; }
replace = String.Replace(str=python_script, searchFor=code_block_3, replaceWith=code_block_4)
create_3dview = Custom[Create 3DView](ViewName=replace@L1, document=ʳʰʸᵗʰᵐ_applications@L1)  # Creates a new isometric View3D in the given document.
code_block_5 = CodeBlock { "IFC2x3"; }
export_ifc_in_document = Custom[Export IFC in Document](document=ʳʰʸᵗʰᵐ_applications@L1, DirectoryPath=code_block_2, view=create_3dview.View@L1, Filename=replace@L1, IFCversion=code_block_5)  # Export Views to IFC file from document. The Project Origin option works only with Revit 2018 and above. Some other IFC options are embedded inside the python script.
