# Dynamo graph wpf_window.dyn (Dynamo 2.3.0.5885)

# group: Dynamo for Revit에서 WPF는 다음 두 줄이면 된다
# note: Dynamo SandBox에서 WPF 실행이 어렵다. ~~
# note: clr.AddReference("PresentationFramework")
# from System.Windows import *

# group: Dynamo SandBox에서 WPF는 Thread, Dispatcher 등으로 연구가 필요하다
# note: Dynamo SandBox에서 WPF 실행이 어렵다. ~~~~~~~~~~~~
# note: Dynamo SandBox에서 WPF 실행이 어렵다.~~~~~~~~~~~~

# group: thread:
boolean = BoolSelector(true)  # frozen
# note: window=System.Windows.Window()
python_script = Python(IN[0]=boolean)
# ---------- python_script.python (40 lines) ----------
# Python 표준 및 DesignScript 라이브러리 로드
import sys
import System
import clr
clr.AddReference('ProtoGeometry')
from Autodesk.DesignScript.Geometry import *

# 이 노드에 대한 입력값은 IN 변수에 리스트로 저장됩니다.
dataEnteringNode = IN[0]

# 코드를 이 선 아래에 배치
#import clr
#clr.AddReference("IronPython.Wpf")
#from IronPython.Modules import Wpf as wpf
#import wpf
clr.AddReference("PresentationFramework")
clr.AddReference('WindowsBase')
from System.Windows import * 
from System.Threading import *

def app_thread():
	window = Window()
	window.Title = "Hello WPF!"
	button = Controls.Button()
	button.Content = "Push Me!"
	panel = Controls.StackPanel()
	window.Content = panel
	panel.Children.Add(button)
	window.Show()
	
if IN[0]:	
	thread = Thread(ThreadStart(app_thread))
	#thread = Thread.ThreadState(app_thread)
	thread.SetApartmentState(ApartmentState.STA)
	thread.Start()
	#thread.Join()
	

# 출력을 OUT 변수에 지정합니다.
OUT = 0
# ----------------------------------------

# group: dispatcher: thread
# note: dispatcher = Dispatcher.CurrentDispatcher
# note: thread = Thread(ThreadStart(app_thread))
python_script_2 = Python()  # frozen; unwired: IN[0]
# ---------- python_script_2.python (39 lines) ----------
# Python 표준 및 DesignScript 라이브러리 로드
import sys
import clr
clr.AddReference('ProtoGeometry')
from Autodesk.DesignScript.Geometry import *

# 이 노드에 대한 입력값은 IN 변수에 리스트로 저장됩니다.
dataEnteringNode = IN
output = []
# 코드를 이 선 아래에 배치
import System
clr.AddReference('WindowsBase')
clr.AddReference('System.Windows.Presentation')
from System import Action
from System.Windows.Threading import DispatcherExtensions, Dispatcher

dispatcher = Dispatcher.CurrentDispatcher

def workCallBack():
	def app_thread():
		window = Window()
		window.Title = "Hello WPF!"
		button = Controls.Button()
		button.Content = "Push Me!"
		panel = Controls.StackPanel()
		window.Content = panel
		panel.Children.Add(button)
		window.Show()
	thread = Thread(ThreadStart(app_thread))
	thread.SetApartmentState(ApartmentState.STA)
	thread.Start()
	thread.Join()

DispatcherExtensions.BeginInvoke(dispatcher, Action(workCallBack))
output.append(dir(Dispatcher))
OUT = output

# 출력을 OUT 변수에 지정합니다.
#OUT = 0
# ----------------------------------------

# group: thread: dispatcher
# note: thread = Thread(ThreadStart(app_thread))
# note: dispatcher = Dispatcher.CurrentDispatcher
python_script_3 = Python()  # frozen; unwired: IN[0]
# ---------- python_script_3.python (37 lines) ----------
# Python 표준 및 DesignScript 라이브러리 로드
import sys
import clr
clr.AddReference('ProtoGeometry')
from Autodesk.DesignScript.Geometry import *

# 이 노드에 대한 입력값은 IN 변수에 리스트로 저장됩니다.
dataEnteringNode = IN
output = []
# 코드를 이 선 아래에 배치
import System
clr.AddReference('WindowsBase')
clr.AddReference('System.Windows.Presentation')
from System import Action
from System.Threading import *
from System.Windows.Threading import DispatcherExtensions, Dispatcher

#dispatcher = Dispatcher.CurrentDispatcher


def app_thread():
	dispatcher = Dispatcher.CurrentDispatcher
	def workCallBack():
		output = " dispatcher"	
	DispatcherExtensions.BeginInvoke(dispatcher, Action(workCallBack))

thread = Thread(ThreadStart(app_thread))
thread.SetApartmentState(ApartmentState.STA)
thread.Start()
#thread.Join()


output.append(dir(Dispatcher))
OUT = output

# 출력을 OUT 변수에 지정합니다.
#OUT = 0
# ----------------------------------------

# group: dispatcher:
# note: dispatcher = Dispatcher.CurrentDispatcher
python_script_4 = Python()  # frozen; unwired: IN[0]
# ---------- python_script_4.python (33 lines) ----------
# Python 표준 및 DesignScript 라이브러리 로드
import sys
import System
import clr
clr.AddReference('ProtoGeometry')
from Autodesk.DesignScript.Geometry import *

# 이 노드에 대한 입력값은 IN 변수에 리스트로 저장됩니다.
dataEnteringNode = IN[0]
output=''
# 코드를 이 선 아래에 배치
#import clr
#clr.AddReference("IronPython.Wpf")
#from IronPython.Modules import Wpf as wpf
#import wpf
clr.AddReference("PresentationFramework")
from System.Windows import * 
clr.AddReference('WindowsBase')
clr.AddReference('System.Windows.Presentation')
from System import Action
from System.Windows.Threading import DispatcherExtensions, Dispatcher

dispatcher = Dispatcher.CurrentDispatcher

def workCallBack():
    print 'working'
    output ='working'

DispatcherExtensions.BeginInvoke(dispatcher, Action(workCallBack))
	

# 출력을 OUT 변수에 지정합니다.
OUT = output
# ----------------------------------------

file_path = Filename(".\dynamo_wpf_python_window.xaml")  # frozen
file_from_path = FileObject(path=file_path)
boolean_2 = BoolSelector(true)  # frozen
python_script_5 = Python(IN[0]=file_from_path, IN[1]=boolean_2)
# ---------- python_script_5.python (38 lines) ----------
# Python 표준 및 DesignScript 라이브러리 로드
import sys
import clr

clr.AddReference('ProtoGeometry')
from Autodesk.DesignScript.Geometry import *

clr.AddReference('IronPython.Wpf')
clr.AddReference('PresentationFramework')
clr.AddReference('PresentationCore')
clr.AddReference('WindowsBase')
import System
from System.IO import File, FileStream, FileMode
from System.Windows import *

from System.Windows.Markup import XamlReader




# 이 노드에 대한 입력값은 IN 변수에 리스트로 저장됩니다.
#dataEnteringNode = IN

# 코드를 이 선 아래에 배치

xamlPath = IN[0]

def buttonClick(*args):
    window.Close()

file = File.OpenRead(xamlPath.ToString())
window = XamlReader.Load(file)
btn = LogicalTreeHelper.FindLogicalNode(window,"button")
btn.Click += buttonClick
window.Show()

# 출력을 OUT 변수에 지정합니다.
OUT = 0
# ----------------------------------------
watch = Watch(file_from_path)

# group: window = Window()
# note: 실행할때 마다 IN[0]에 True, False를 번갈아 입력한다.
boolean_3 = BoolSelector(false)  # frozen
python_script_6 = Python(IN[0]=boolean_3)  # frozen
# ---------- python_script_6.python (32 lines) ----------
# Python 표준 및 DesignScript 라이브러리 로드
import sys
import System
import clr
clr.AddReference('ProtoGeometry')
from Autodesk.DesignScript.Geometry import *

# 이 노드에 대한 입력값은 IN 변수에 리스트로 저장됩니다.
dataEnteringNode = IN[0]

# 코드를 이 선 아래에 배치
#import clr
#clr.AddReference("IronPython.Wpf")
#from IronPython.Modules import Wpf as wpf
#import wpf
clr.AddReference("PresentationFramework")
#clr.AddReference('WindowsBase')
from System.Windows import * 
#from System.Threading import *


window = Window()
window.Title = "Hello WPF!"
button = Controls.Button()
button.Content = "Push Me!  "+ str(dataEnteringNode)
panel = Controls.StackPanel()
window.Content = panel
panel.Children.Add(button)
window.Show()
	
# 출력을 OUT 변수에 지정합니다.
OUT = 0
# ----------------------------------------
string = StringInput("""# Python 표준 및 DesignScript 라이브러리 로드
import sys
import System
import clr
clr.AddReference('ProtoGeometry')
from Autodesk.DesignScript.Geometry import *
clr.AddReference("PresentationFramework")
from System.Windows import * 

# 이 노드에 대한 입력값은 IN 변수에 리스트로 저장됩니다.
dataEnteringNode = IN[0]

# 코드를 이 선 아래에 배치
window = Window()
window.Title = "Hello WPF!"
button = Controls.Button()
button.Content = "Push Me!  "+ str(dataEnteringNode)
panel = Controls.StackPanel()
window.Content = panel
panel.Children.Add(button)
window.Show()
	
# 출력을 OUT 변수에 지정합니다.
OUT = 0""")  # frozen
boolean_4 = BoolSelector(false)  # frozen
python_script_from_string = PythonStringNode(script=string, IN[0]=boolean_4)  # frozen
file_path_2 = Filename(".\wpf_window_dynamo.py")
file_from_path_2 = FileObject(path=file_path_2)
readText = FileSystem.ReadText(file=file_from_path_2)
boolean_5 = BoolSelector(true)
python_script_from_string_2 = PythonStringNode(script=readText, IN[0]=boolean_5)

string_2 = StringInput("""# Python 표준 및 DesignScript 라이브러리 로드
import sys
import clr

clr.AddReference('ProtoGeometry')
from Autodesk.DesignScript.Geometry import *

clr.AddReference('IronPython.Wpf')
clr.AddReference('PresentationFramework')
clr.AddReference('PresentationCore')
clr.AddReference('WindowsBase')
import System
from System.IO import File, FileStream, FileMode
from System.Windows import *

from System.Windows.Markup import XamlReader

# 이 노드에 대한 입력값은 IN 변수에 리스트로 저장됩니다.
#dataEnteringNode = IN

# 코드를 이 선 아래에 배치

xamlPath = IN[0]

def buttonClick(*args):
    window.Close()

file = File.OpenRead(xamlPath.ToString())
window = XamlReader.Load(file)
btn = LogicalTreeHelper.FindLogicalNode(window,"button")
btn.Click += buttonClick
window.Show()

# 출력을 OUT 변수에 지정합니다.
OUT = 0""")  # frozen

# group: .xaml
file_path_3 = Filename(".\wpf_window_python.xaml")  # frozen
file_from_path_3 = FileObject(path=file_path_3)
readText_2 = FileSystem.ReadText(file=file_from_path_3)
watch_2 = Watch(readText_2)

boolean_6 = BoolSelector(true)
python_script_from_string_3 = PythonStringNode(script=string_2, IN[0]=file_from_path_3, IN[1]=boolean_6)

# group: .xaml.dynamo.py
file_path_4 = Filename(".\wpf_window_python.xaml.dynamo.py")  # frozen
file_from_path_4 = FileObject(path=file_path_4)
readText_3 = FileSystem.ReadText(file=file_from_path_4)
watch_3 = Watch(readText_3)

python_script_from_string_4 = PythonStringNode(script=readText_3, IN[0]=file_from_path_3, IN[1]=boolean_6)
