# Dynamo graph wpf_window_dynamosandbox.dyn (Dynamo 2.10.0.3455)

boolean = BoolSelector(false)
python_script = Python(IN[0]=boolean)  # IronPython2
# ---------- python_script.python (28 lines) ----------
# Python 표준 및 DesignScript 라이브러리 로드
import sys
import clr
clr.AddReference('ProtoGeometry')
from Autodesk.DesignScript.Geometry import *
import System.Windows
from System.Threading import Thread, ThreadStart, ApartmentState
clr.AddReference('PresentationFramework')

# 이 노드에 대한 입력값은 IN 변수에 리스트로 저장됩니다.
dataEnteringNode = IN

# 코드를 이 선 아래에 배치

# Initialization Constants
Window = System.Windows.Window
Application = System.Windows.Application

def appThread():
    my_window = Window()
    my_window.Show()
    
if System.Diagnostics.Process.GetCurrentProcess().ProcessName == "Revit":
	thread = appThread()
else:
	thread = Application.Current.Dispatcher.Invoke(appThread)
# 출력을 OUT 변수에 지정합니다.
OUT = 0
# ----------------------------------------
boolean_2 = BoolSelector(false)
python_script_2 = Python(IN[0]=boolean_2)  # IronPython2
# ---------- python_script_2.python (33 lines) ----------
# Python 표준 및 DesignScript 라이브러리 로드
import sys
import clr
clr.AddReference('ProtoGeometry')
from Autodesk.DesignScript.Geometry import *
import System.Windows
from System.Threading import Thread, ThreadStart, ApartmentState
clr.AddReference('PresentationFramework')
from System.Windows import *

# 이 노드에 대한 입력값은 IN 변수에 리스트로 저장됩니다.
dataEnteringNode = IN

# 코드를 이 선 아래에 배치

# Initialization Constants
Window = System.Windows.Window
Application = System.Windows.Application
def appThread():
	window = Window()
	window.Title = "Hello WPF!"
	button = Controls.Button()
	button.Content = "Push Me!  "+ str(dataEnteringNode)
	panel = Controls.StackPanel()
	window.Content = panel
	panel.Children.Add(button)
	window.Show()
if System.Diagnostics.Process.GetCurrentProcess().ProcessName == "Revit":
	thread = appThread()
else:
	thread = Application.Current.Dispatcher.Invoke(appThread)
# 출력을 OUT 변수에 지정합니다.
OUT = 0
# ----------------------------------------
boolean_3 = BoolSelector(true)
python_script_3 = Python(IN[0]=boolean_3)  # IronPython2; frozen
# ---------- python_script_3.python (85 lines) ----------
# Python 표준 및 DesignScript 라이브러리 로드
import sys
import clr
clr.AddReference('ProtoGeometry')
from Autodesk.DesignScript.Geometry import *

# 이 노드에 대한 입력값은 IN 변수에 리스트로 저장됩니다.
dataEnteringNode = IN

# 코드를 이 선 아래에 배치
#import clr

# Reference the WPF assemblies
#import sys
import System.Windows
from wpf import *
clr.AddReference('PresentationFramework')
clr.AddReference('RevitAPI')
clr.AddReference('RevitAPIUI')
clr.AddReference('RevitServices')
# noinspection PyUnresolvedReferences
from Autodesk.Revit.UI import IExternalEventHandler, ExternalEvent
# noinspection PyUnresolvedReferences
from Autodesk.Revit.DB import Transaction
# noinspection PyUnresolvedReferences
from Autodesk.Revit.Exceptions import InvalidOperationException

from RevitServices import *
from RevitServices.Persistence import DocumentManager
from Autodesk.Revit.UI import *
from Autodesk.Revit.UI.Selection import *
doc = DocumentManager.Instance.CurrentDBDocument
uidoc = DocumentManager.Instance.CurrentUIApplication.ActiveUIDocument
# Initialization Constants
Window = System.Windows.Window

# Simple function we want to run
def delete_elements():
    t = Transaction(doc, "Failing script")
    t.Start()
    for elid in uidoc.Selection.GetElementIds():
        print elid
        doc.Delete(elid)
    t.Commit()
    
# Create a subclass of IExternalEventHandler
class SimpleEventHandler(IExternalEventHandler):
    """
    Simple IExternalEventHandler sample
    """
    # __init__ is used to make function from outside of the class to be executed by the handler. \
    # Instructions could be simply written under Execute method only
    def __init__(self, do_this):
        self.do_this = do_this
    # Execute method run in Revit API environment.
    def Execute(self, uiapp):
        try:
            self.do_this()
        except InvalidOperationException:
            # If you don't catch this exeption Revit may crash.
            print "InvalidOperationException catched"
    def GetName(self):
        return "simple function executed by an IExternalEventHandler in a Form"
# Now we need to make an instance of this handler. Moreover, it shows that the same class could be used to for
# different functions using different handler class instances
simple_event_handler = SimpleEventHandler(delete_elements)
# We now need to create the ExternalEvent
ext_event = ExternalEvent.Create(simple_event_handler)

# A simple WPF form used to call the ExternalEvent
class ModelessForm(Window):#WPFWindow):
    """
    Simple modeless form sample#
    """
    def __init__(self):
        Window.__init__(self)
        self.Title = "Hello World"
        self.Show()
    def delete_click(self, sender, e):
        # This Raise() method launch a signal to Revit to tell him you want to do something in the API context
        ext_event.Raise()
# Let's launch our beautiful and useful form !
modeless_form = ModelessForm()
# 출력을 OUT 변수에 지정합니다.
OUT = 0
# ----------------------------------------
python_script_4 = Python()  # IronPython2; unwired: IN[0]
# ---------- python_script_4.python (15 lines) ----------
# Python 표준 및 DesignScript 라이브러리 로드
import sys
import clr
clr.AddReference('ProtoGeometry')
from Autodesk.DesignScript.Geometry import *
import System.Windows

# 이 노드에 대한 입력값은 IN 변수에 리스트로 저장됩니다.
dataEnteringNode = IN

# 코드를 이 선 아래에 배치

# 출력을 OUT 변수에 지정합니다.
#OUT = System.Diagnostics.Process.GetCurrentProcess().ProcessName
OUT = __name__
# ----------------------------------------
boolean_4 = BoolSelector(false)
python_script_5 = Python(IN[0]=boolean_4)  # IronPython2
# ---------- python_script_5.python (52 lines) ----------
# Python 표준 및 DesignScript 라이브러리 로드
import sys
import clr
clr.AddReference('ProtoGeometry')
from Autodesk.DesignScript.Geometry import *
import System.Windows
from System.Threading import Thread, ThreadStart, ApartmentState
clr.AddReference('PresentationFramework')
from System.Windows import *

import wpf
# 이 노드에 대한 입력값은 IN 변수에 리스트로 저장됩니다.
dataEnteringNode = IN

# 코드를 이 선 아래에 배치
class MyWindow(Window):
    layout ="""
			<Window xmlns="http://schemas.microsoft.com/winfx/2006/xaml/presentation" 
			       xmlns:x="http://schemas.microsoft.com/winfx/2006/xaml" 
			       Title="WpfApplication1" Height="351" Width="500">
			    <StackPanel Margin="5">
			        <Button Margin="5" x:Name="Toggle">Click Me!</Button>
			        <Label Margin="5" FontSize="48" x:Name="OneTwo">Two</Label>
			    </StackPanel>
			</Window>
			"""
    def __init__(self):
        wpf.LoadComponent(self,System.IO.StringReader(MyWindow.layout))# 'WpfApplication1.xaml')
        self.Toggle.Click += self.sayhello

    def sayhello(self, s,e) :
        if self.OneTwo.Content == "Two" :
           self.OneTwo.Content = "one" 
        else :
          self.OneTwo.Content  = "Two"   
# Initialization Constants
Window = System.Windows.Window
Application = System.Windows.Application
OUT = 0
def appThread():
	win = MyWindow()
	win.ShowDialog()
	print win.OneTwo.Content + '== inside'
	return win.OneTwo.Content

if System.Diagnostics.Process.GetCurrentProcess().ProcessName == "Revit":
	thread = appThread()
else:
	thread = Application.Current.Dispatcher.Invoke(appThread)
# 출력을 OUT 변수에 지정합니다.
OUT = thread
#print win.OneTwo.Content + '== outside' # Warning
# ----------------------------------------
